# Grasshopper definition PanTheremin_grasshopper.gh (Grasshopper 1.0.7)
# plug-ins: Firefly.X

timer = Timer(TimerInterval=20, Target=osc_listener)
osc_listener = OSCListener(Port=57120, Reset=Toggle(False))
item = TreeItem(Tree=osc_listener, Path="{2}", Index=1, Wrap=True)
item_2 = TreeItem(Tree=osc_listener, Path="{0}", Index=1, Wrap=True)
item_3 = TreeItem(Tree=osc_listener, Path="{1}", Index=1, Wrap=True)
item_4 = TreeItem(Tree=osc_listener, Path="{3}", Index=1, Wrap=True)
max = Maximum(A=item_2, B=item_3)
max_2 = Maximum(A=max, B=item)

# ---- group: accelrometer controls size
dom = ConstructDomain(DomainStart=170, DomainEnd=200)
dom_2 = ConstructDomain(DomainStart=0, DomainEnd=127)
remap = RemapNumbers(Value=item_4, Source=dom_2, Target=dom)  # -> Mapped, Clipped

# ---- group: velocity controls colors
dom_3 = ConstructDomain(DomainStart=0, DomainEnd=8)
dom_4 = ConstructDomain(DomainStart=0, DomainEnd=255)
dom_5 = ConstructDomain(DomainStart=0, DomainEnd=100)
remap_2 = RemapNumbers(Value=item_2, Source=dom_3, Target=dom_5)  # -> Mapped, Clipped
remap_3 = RemapNumbers(Value=item_3, Source=dom_3, Target=dom_5)  # -> Mapped, Clipped
remap_4 = RemapNumbers(Value=item, Source=dom_3, Target=dom_4)  # -> Mapped, Clipped

# ---- group: notes control ripples
dom_6 = ConstructDomain(DomainStart=0, DomainEnd=8)
dom_7 = ConstructDomain(DomainStart=0, DomainEnd=40)
remap_5 = RemapNumbers(Value=max_2, Source=dom_6, Target=dom_7)  # -> Mapped, Clipped

# ----
multiplication = Multiplication(A=remap.Clipped, B=0.25)
rgb = ColourRGB(Alpha=255, Red=remap_2.Mapped, Green=remap_3.Mapped, Blue=remap_4.Mapped)
series = Series(Start=Slider(1, range=0..10), Step=Slider(2, range=0..10), Count=multiplication)

# ---- group: input to control ripples
rec = DataRecorder(remap_5.Mapped, DataLimit=20, RecordData=True)

# ----
multiplication_2 = Multiplication(A=series, B=0.25)
cir = Circle(Plane=PlaneXY(0, 0, 0), Radius=multiplication_2)
circle = Circle([{Plane=Plane(origin=(-14.41652537, -25.55512556, 0), x=(-0.2982749931, -0.954479978, 0), y=(0.954479978, -0.2982749931, 0)), Radius=1.044792236}, {Plane=Plane(origin=(-16.24478636, -24.53711659, 0), x=(-0.2003962361, -0.9797149323, 0), y=(0.9797149323, -0.2003962361, 0)), Radius=0.9330576356}, {Plane=Plane(origin=(-17.98994459, -23.39445347, 0), x=(0, -1, 0), y=(1, 0, 0)), Radius=0.9972332709}, {Plane=Plane(origin=(-19.71432712, -22.14791188, 0), x=(0.1293391841, -0.9916004112, 0), y=(0.9916004112, 0.1293391841, 0)), Radius=0.9637772169}, {Plane=Plane(origin=(-21.23095272, -20.83904321, 0), x=(0.1682964629, -0.9857364255, 0), y=(0.9857364255, 0.1682964629, 0)), Radius=0.864128987}, {Plane=Plane(origin=(-22.68525124, -19.23931484, 0), x=(0.1210543753, -0.9926458776, 0), y=(0.9926458776, 0.1210543753, 0)), Radius=0.858114095}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])
circle_2 = Circle([{Plane=Plane(origin=(-1.655996408, -35.04048239, 0), x=(-0.04993761694, -0.9987523389, 0), y=(0.9987523389, -0.04993761694, 0)), Radius=1.091836824}, {Plane=Plane(origin=(-3.755159977, -34.93143494, 0), x=(-0.08191555673, -0.9966392735, 0), y=(0.9966392735, -0.08191555673, 0)), Radius=0.9984134503}, {Plane=Plane(origin=(-5.881585412, -34.68607815, 0), x=(0, -1, 0), y=(1, 0, 0)), Radius=1.049581785}, {Plane=Plane(origin=(-7.926225252, -34.37256671, 0), x=(0.1375683713, -0.9904922732, 0), y=(0.9904922732, 0.1375683713, 0)), Radius=0.990847834}, {Plane=Plane(origin=(-9.902710432, -33.96363874, 0), x=(0.04343722428, -0.9990561584, 0), y=(0.9990561584, 0.04343722428, 0)), Radius=0.9414228808}, {Plane=Plane(origin=(-11.83830281, -33.309354, 0), x=(-0.1221552013, -0.9925110109, 0), y=(0.9925110109, -0.1221552013, 0)), Radius=0.8926959881}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])
circle_3 = Circle([{Plane=Plane(origin=(12.90495917, 26.14208555, 0), x=(0.1451141874, -0.9894149143, 0), y=(0.9894149143, 0.1451141874, 0)), Radius=1.033257035}, {Plane=Plane(origin=(14.6497185, 25.13339656, 0), x=(-0.1643989873, -0.9863939238, 0), y=(0.9863939238, -0.1643989873, 0)), Radius=0.9949646889}, {Plane=Plane(origin=(16.42173969, 23.94750545, 0), x=(-0.09950371902, -0.9950371902, 0), y=(0.9950371902, -0.09950371902, 0)), Radius=0.9589242175}, {Plane=Plane(origin=(18.0710825, 22.58441222, 0), x=(0.01470429244, -0.999891886, 0), y=(0.999891886, 0.01470429244, 0)), Radius=0.9270036165}, {Plane=Plane(origin=(19.55685412, 21.16679527, 0), x=(-0.2136968788, -0.9769000174, 0), y=(0.9769000174, -0.2136968788, 0)), Radius=0.8930081378}, {Plane=Plane(origin=(21.00173294, 19.66739272, 0), x=(-0.06336447318, -0.9979904526, 0), y=(0.9979904526, -0.06336447318, 0)), Radius=0.8604779042}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])
circle_4 = Circle([{Plane=Plane(origin=(-11.53828162, -29.00383245, 0), x=(0.07974522228, -0.9968152785, 0), y=(0.9968152785, 0.07974522228, 0)), Radius=1.025586126}, {Plane=Plane(origin=(-13.52839773, -28.25413117, 0), x=(0.127164316, -0.9918816647, 0), y=(0.9918816647, 0.127164316, 0)), Radius=1.071914882}, {Plane=Plane(origin=(-15.36857358, -27.3817515, 0), x=(0.2860355264, -0.9582190134, 0), y=(0.9582190134, 0.2860355264, 0)), Radius=0.9530936554}, {Plane=Plane(origin=(-17.26327317, -26.35943158, 0), x=(0.07554111273, -0.997142688, 0), y=(0.997142688, 0.07554111273, 0)), Radius=0.9022194523}, {Plane=Plane(origin=(-18.95350877, -25.22806421, 0), x=(0.1961161351, -0.9805806757, 0), y=(0.9805806757, 0.1961161351, 0)), Radius=0.9035570653}, {Plane=Plane(origin=(-20.67100624, -23.98764937, 0), x=(0.2136968788, -0.9769000174, 0), y=(0.9769000174, 0.2136968788, 0)), Radius=0.8930081378}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])
circle_5 = Circle([{Plane=Plane(origin=(0.3489766531, 36.06301222, 0), x=(0.9393573198, -0.3429399739, 0), y=(0.3429399739, 0.9393573198, 0)), Radius=1.128626561}, {Plane=Plane(origin=(2.51982883, 35.84424417, 0), x=(0.5829078755, -0.8125382506, 0), y=(0.8125382506, 0.5829078755, 0)), Radius=0.9526964742}, {Plane=Plane(origin=(4.556054514, 35.5918195, 0), x=(0.3772968873, -0.9260923598, 0), y=(0.9260923598, 0.3772968873, 0)), Radius=0.9812507451}, {Plane=Plane(origin=(6.625936822, 35.20476834, 0), x=(0.1334120121, -0.9910606616, 0), y=(0.9910606616, 0.1334120121, 0)), Radius=0.882965321}, {Plane=Plane(origin=(8.648547762, 34.71825887, 0), x=(0.2538981284, -0.9672309654, 0), y=(0.9672309654, 0.2538981284, 0)), Radius=0.9132094017}, {Plane=Plane(origin=(10.64697874, 34.01163135, 0), x=(0.4420059671, -0.8970121097, 0), y=(0.8970121097, 0.4420059671, 0)), Radius=0.849300468}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])
circle_6 = Circle([{Plane=Plane(origin=(-8.539476516, -32.04353034, 0), x=(-0.2304663839, -0.9730802875, 0), y=(0.9730802875, -0.2304663839, 0)), Radius=1.064609844}, {Plane=Plane(origin=(-10.61137822, -31.51192398, 0), x=(-0.1936330319, -0.9810740283, 0), y=(0.9810740283, -0.1936330319, 0)), Radius=1.055935457}, {Plane=Plane(origin=(-12.53333967, -30.8849011, 0), x=(-0.07124704999, -0.9974586998, 0), y=(0.9974586998, -0.07124704999, 0)), Radius=0.9565962572}, {Plane=Plane(origin=(-14.45530112, -30.16246169, 0), x=(0.1009312151, -0.9948934063, 0), y=(0.9948934063, 0.1009312151, 0)), Radius=0.9453619059}, {Plane=Plane(origin=(-16.40452444, -29.26282016, 0), x=(0, -1, 0), y=(1, 0, 0)), Radius=0.9269033944}, {Plane=Plane(origin=(-18.23106936, -28.18597651, 0), x=(0.131208719, -0.991354766, 0), y=(0.991354766, 0.131208719, 0)), Radius=0.9349865721}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])
circle_7 = Circle([{Plane=Plane(origin=(7.111812952, 32.88939702, 0), x=(-0.131208719, -0.991354766, 0), y=(0.991354766, -0.131208719, 0)), Radius=0.9349865721}, {Plane=Plane(origin=(9.19734559, 32.31689786, 0), x=(-0.03123475238, -0.9995120761, 0), y=(0.9995120761, -0.03123475238, 0)), Radius=0.872805528}, {Plane=Plane(origin=(11.20109263, 31.64898218, 0), x=(-0.2845982884, -0.9586468663, 0), y=(0.9586468663, -0.2845982884, 0)), Radius=0.9100114923}, {Plane=Plane(origin=(13.13668502, 30.79023345, 0), x=(-0.3303504247, -0.9438583564, 0), y=(0.9438583564, -0.3303504247, 0)), Radius=0.8665028293}, {Plane=Plane(origin=(15.0313846, 29.82243726, 0), x=(-0.134363673, -0.9909320882, 0), y=(0.9909320882, -0.134363673, 0)), Radius=0.8115843796}, {Plane=Plane(origin=(16.762513, 28.75922454, 0), x=(0.1028991511, -0.9946917938, 0), y=(0.9946917938, 0.1028991511, 0)), Radius=0.7948131035}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])
circle_8 = Circle([{Plane=Plane(origin=(10.11061805, 29.76791353, 0), x=(-0.0776865842, -0.9969778306, 0), y=(0.9969778306, -0.0776865842, 0)), Radius=1.052763414}, {Plane=Plane(origin=(12.05984137, 29.01821226, 0), x=(-0.2594565113, -0.9657547922, 0), y=(0.9657547922, -0.2594565113, 0)), Radius=0.9456566713}, {Plane=Plane(origin=(13.88638629, 28.09130886, 0), x=(-0.2558925603, -0.9667052279, 0), y=(0.9667052279, -0.2558925603, 0)), Radius=0.958827332}, {Plane=Plane(origin=(15.68566935, 26.94631055, 0), x=(-0.5189781342, -0.8547875152, 0), y=(0.8547875152, -0.5189781342, 0)), Radius=0.8930081378}, {Plane=Plane(origin=(17.47132148, 25.74678851, 0), x=(-0.5547001962, -0.8320502943, 0), y=(0.8320502943, -0.5547001962, 0)), Radius=0.8846464542}, {Plane=Plane(origin=(19.14792615, 24.45184994, 0), x=(-0.4220295802, -0.9065820611, 0), y=(0.9065820611, -0.4220295802, 0)), Radius=0.8720601319}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])
circle_9 = Circle([{Plane=Plane(origin=(15.05864647, 22.33905544, 0), x=(0.1223612421, -0.9924856303, 0), y=(0.9924856303, 0.1223612421, 0)), Radius=1.002591902}, {Plane=Plane(origin=(16.69435834, 20.97596222, 0), x=(-0.04281783839, -0.9990828958, 0), y=(0.9990828958, -0.04281783839, 0)), Radius=0.9550411312}, {Plane=Plane(origin=(18.27554648, 19.55834526, 0), x=(-0.01408311025, -0.9999008281, 0), y=(0.9999008281, -0.01408311025, 0)), Radius=0.967892179}, {Plane=Plane(origin=(19.69316344, 18.01804991, 0), x=(0.04540766092, -0.9989685402, 0), y=(0.9989685402, 0.04540766092, 0)), Radius=0.9005704321}, {Plane=Plane(origin=(20.96084014, 16.27329058, 0), x=(-0.1737853339, -0.9847835588, 0), y=(0.9847835588, -0.1737853339, 0)), Radius=0.9412254968}, {Plane=Plane(origin=(22.14673125, 14.54216218, 0), x=(-0.03173004683, -0.9994964753, 0), y=(0.9994964753, -0.03173004683, 0)), Radius=0.8591813521}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])
multiplication_3 = Multiplication(A=rec, B=Slider(5.4, range=0..10))
Z = UnitZ(Factor=multiplication_3)
pt = ConstructPoint(XCoordinate=series, YCoordinate=0, ZCoordinate=0)
pt_2 = Point(Point(0, 0, 0))
expression = Expression(P=pt_2, V=pt, Expression="Distance(P,V)/2500")
multiplication_4 = Multiplication(A=Z, B=expression)
brep = Brep(flatten([circle_2, circle_6, circle_4, circle, circle_9, circle_3, circle_8, circle_7, circle_5]))
move = Move(Geometry=reverse(cir), Motion=multiplication_4)  # -> Geometry, Transform
preview = CustomPreview(Geometry=brep, Material=rgb)
loft = Loft(Curves=move.Geometry, Options={Adjust=False, Closed=False, LoftEnds=0, LoftSimp=0, LoftType=0, Rebuild=10, Refit=0.01})
material = CreateMaterial(
    Diffuse=rgb,
    Specular=RGB(255, 255, 255),
    Emission=ColourSwatch(SwatchColor=RGB(41, 82, 135)),
    Transparency=0,
    Shine=Slider(100, range=0..100))
preview_2 = CustomPreview(Geometry=loft, Material=material)
